vi "New Layer Prompt.gvi"   [LabVIEW NXG 5.0.0]
inputs:
  "Error In": error
outputs:
  "Error Out": error
panel controls:
  "Layer Type": "Layer Type.gtype" = "Front Electrode"
  "Deposition Method": "Deposition Method.gtype" = "Blade Coating"
  "Blade Coating Parameters": "Blade Coating Parameters.gtype"
  "Solution Information": "Solution Information.gtype"
  "Spin Coating Parameters": "Spin Coating Parameters.gtype"
  "Thermal Evaporation Parameters": "Thermal Evaporation Parameters.gtype"
  "General Parameters": "General Parameters.gtype"
  "Add Layer Button": bool
  "Misc Data Mega Cluster In": "Misc Mega Cluster.gtype"
  "New Layer Prompt Ref Cluster In": "New Layer Prompt Ref Cluster.gtype"
  "Full Layer Information": "Full Layer Information.gtype"
  "Save Layer File": bool
  "Load Layer File": bool
panel indicators:
  "Misc Mega Cluster Data Out": "Misc Mega Cluster.gtype"
types:
  "Layer Type.gtype" = enum{"Front Electrode", "Electrode Transport Layer", "Active Layer", "Hole Transport Layer", "Back Electrode", "Annealing Treatment", "Encapsulation", "Custom Layer"}
  "Deposition Method.gtype" = enum{"Blade Coating", "Spin Coating", "Thermal Evaporation", "E-beam Evaporation", "Sputtering", "Drop Casting", "Dip Coating", "Pulsed Laser Deposition", "Chemical Vapour Deposition", "Atomic Layer Deposition", "Spray Coating", "Screen Printing", "Electroplating", "Molecular Beam Epitaxy", "Custom Deposition"}
  "Blade Coating Parameters.gtype" = cluster{"Thickness (nm)": f64, "Blade Initial Speed (mm/s)": f64, "Speed Gradient": bool, "Blade Final Speed (mm/s)": f64, "Blade Gap (um)": f64, "Blade Temperature (ºC)": f64, "Droplet Volume (ul)": f64, "Subsequent layers": f64, "Glovebox": bool, "Comments": string}
  "Solution Information.gtype" = cluster{"Concentration (mg/ml)": f64, "Stirring Time (kr)": f64, "Glovebox": bool, "Composition Array": cluster{"Material": string, "Ratio": f64}[], "Solvent Array": cluster{"Solvent": string, "Ratio": f64}[], "Solution Preparation Date": f64, "Comments": string}
  "Spin Coating Parameters.gtype" = cluster{"Thickness (nm)": f64, "Spin Speed (rpm)": f64, "Dynamic Deposition": bool, "Spin Acceleration (rpm/s)": f64, "Droplet Volume (ul)": f64, "Subsequent layers": f64, "Glovebox": bool, "Comments": string}
  "Thermal Evaporation Parameters.gtype" = cluster{"Thickness (nm)": f64, "Deposition Rate (nm/s)": f64, "Comments": string, "Sample Rotation": bool, "Material": string}
  "General Parameters.gtype" = cluster{"Thickness (nm)": f64, "Comments": string, "Material": string}
  T1 = cluster{"State Ref": "StringControl reference", "Substate Ref": "StringControl reference", "Current State Ref": "EnumSelector reference", "Main Tab Ref": "TabControl reference", "Plot Now Flag Ref": "BooleanControl reference"}
  T2 = cluster{"Default Data Saving Location Ref": "PathSelector reference"}
  T3 = cluster{"Author Initials Ref": "ComboBoxSelector reference", "Batch Name Ref": "StringControl reference", "Cell Number Ref": "StringControl reference", "Current Date Ref": "StringControl reference", "Sample Comments Ref": "StringControl reference", "Sample Prefix Ref": "StringControl reference", "Custom Date Ref": "CheckBox reference", "Label Info Error Label Ref": "StringControl reference", "Label Info Missing Error Ref": "BooleanControl reference"}
  T4 = cluster{"Cell Parameters Ref": "Cluster reference", "Cell Selector Ref": "Cluster reference", "Measurement Precision Ref": "Cluster reference", "JV Scan Mode Ref": "EnumSelector reference"}
  T5 = cluster{"Progress % Ref": "ProgressBar reference", "Progress Counter Ref": "NumericTextBoxDouble reference", "Live JV Parameters Ref": "Cluster reference"}
  T6 = cluster{"Layer Information Ref": "ArrayViewer reference"[]}
  T7 = cluster{"Cell Selector Block Ref": "Rectangle reference", "Smart Mode Block Ref": "Rectangle reference", "dV Block Ref": "Rectangle reference", "Smart Mode Text Ref": "Text reference", "No Multiplexer Detected Text Ref": "Text reference"}
  T8 = cluster{"JV Measurements Mega Cluster Ref": "Cluster reference", "Instrument Control Mega Cluster Ref": "Cluster reference"}
  T9 = cluster{"JV Main Graph Ref": "Graph reference", "Voc Graph Ref ": "Graph reference", "Jsc Graph Ref": "Graph reference", "Efficiency Graph Ref": "Graph reference", "Fill Factor Graph Ref": "Graph reference", "Series Resistance Graph Ref": "Graph reference", "Shunt Resistance Graph Ref": "Graph reference"}
  "Full Reference Cluster.gtype" = cluster{"Status Report": T1, "Path Cluster": T2, "Sample Naming Cluster": T3, "Acquisition Parameters": T4, "Live Progress Cluster": T5, "Sample Extra Information": T6, "Visual Elements": T7, "Mega Cluster References": T8, "Plotting": T9, "System Parameters": cluster{"Main VI Ref": VIRefnum}}
  "Misc Mega Cluster.gtype" = cluster{"Full Reference Cluster": "Full Reference Cluster.gtype"}
  "New Layer Prompt Ref Cluster.gtype" = cluster{"Add Layer Button Ref": "BooleanControl reference", "This VI Ref": VIRefnum, "Blade Coating Parameters Ref": "Cluster reference", "Deposition Method Ref": "EnumSelector reference", "General Parameters Ref": "Cluster reference", "Layer Type ref": "EnumSelector reference", "Solution Information Ref": "Cluster reference", "Spin Coating Parameters Ref": "Cluster reference", "Thermal Evaporation Parameters Ref": "Cluster reference", "Load Layer File Ref": "BooleanControl reference", "Save Layer File Ref": "BooleanControl reference"}
  "Useless Cluster.gtype" = cluster{"Blade Coating Information": bool, "General Information": bool, "Solution Information": bool, "Spin Coating Information": bool, "Thermal Evaporation Information": bool}
  "Full Layer Information.gtype" = cluster{"Blade Coating Parameters": "Blade Coating Parameters.gtype", "Deposition Method": "Deposition Method.gtype", "Layer Type": "Layer Type.gtype", "Spin Coating Parameters": "Spin Coating Parameters.gtype", "Thermal Evaporation Parameters": "Thermal Evaporation Parameters.gtype", "Solution Information": "Solution Information.gtype", "General Parameters": "General Parameters.gtype", "Current Deposition Method Information Cluster": "Useless Cluster.gtype", "Layer String ID": string}
uses:
  Pika IV Characterization NXG::Main Functions::Layer Composition::Controls and Data Clusters::New Layer Reference Setting.gvi
  Pika IV Characterization NXG::Main Functions::Layer Composition::Check and Set Control Visibility.gvi
  Pika IV Characterization NXG::Main Functions::Layer Composition::Data Management::Layer Information Cluster Subroutine.gvi
  Pika IV Characterization NXG::Main Functions::Layer Composition::File Management::Default Configuration Handler.gvi
diagram:
  case ($"Error In") {
    frame Error, Default {
      w1 = $"Error In"
      w2 = $"Misc Data Mega Cluster In"
    }
    frame No Error {
      This VI Reference() -> (reference out=w3)
      Property Node(instance in=w3, error in=$"Error In") -> ("Panel"=w4, error out=w5)
      Property Node(instance in=w4, error in=w5) -> ("Window"=w6, error out=w7)
      Open Window(reference in=w6, error in=w7) -> (error out=w8)
      Property Node(instance in=reference to "Deposition Method", "ValueSignaling"="Blade Coating", error in=w8) -> (error out=w9)
      case (TRUE) {
        frame False, Default {
          w10 = default
          w11 = w9
        }
        frame True {
          This VI Reference() -> (reference out=w12)
          call "New Layer Reference Setting.gvi"(Error In=w9, This VI Ref=w12, Add Layer Button Ref=reference to "Add Layer Button", Blade Coating ParametersRef=reference to "Blade Coating Parameters", Deposition Method Ref=reference to "Deposition Method", General ParametersRef=reference to "General Parameters", Layer Type ref=reference to "Layer Type", Solution Information Ref=reference to "Solution Information", Spin Coating ParametersRef=reference to "Spin Coating Parameters", Thermal Evaporation ParametersRef=reference to "Thermal Evaporation Parameters", Load Layer File Ref=reference to "Load Layer File", Save Layer File Ref=reference to "Save Layer File", New Layer Prompt Ref Cluster In=$"New Layer Prompt Ref Cluster In") -> (Error Out=w11, New Layer Prompt Ref Cluster Out=w10)
        }
      }
      s1 = w11  # shift register
      s2 = w10  # shift register
      s3 = $"Misc Data Mega Cluster In"  # shift register
      while {
        event (timeout = 50) {
          on "Timeout" {
            w13 = s1
            w14 = s2
            w15 = default
            w16 = s3
          }
          on "Deposition Method" Value changed {
            call "Check and Set Control Visibility.gvi"(New Layer Prompt Ref Cluster In=s2, Error In=s1) -> (New Layer Prompt Ref Cluster Out=w14, Error Out=w13)
            w15 = default
            w16 = s3
          }
          on "Add Layer Button" Value changed {
            call "Layer Information Cluster Subroutine.gvi"(New Layer Prompt Ref Cluster In=s2, Full Layer Information In=$"Full Layer Information", Error In=s1) -> (New Layer Prompt Ref Cluster Out=w14, Full Layer Information Out=w17, Error Out=w13)
            $"Full Layer Information" <- w17
            w15 = TRUE
            w16 = s3
          }
          on "Save Layer File" Value changed {
            call "Default Configuration Handler.gvi"(Misc Data Mega Cluster In=s3, Full Layer Information In=$"Full Layer Information", Error In=s1) -> (Misc Data Mega Cluster Out=w16, Error Out=w13)
            w14 = s2
            w15 = default
          }
        }
        next s1 = w13
        next s2 = w14
        next s3 = w16
        stop if w15
      }
      w1 = s1
      w2 = s3
    }
  }
  $"Misc Mega Cluster Data Out" <- w2
  $"Error Out" <- w1
